# Dynamo graph Purging Material like wth....dyn (Dynamo 2.6.1.8786)

categories = Categories("OST_Materials")
all_elements_of_category = ElementsOfCategory(Category=categories)
name = Element.Name(element=all_elements_of_category)

# group: Creating a Boolean where Line Patterns including "IMPORT" (from CAD) will return 'true', This way we can create a separate list to purge them out.
code_block = CodeBlock { "Render"; }
code_block_2 = CodeBlock { false; }
contains = String.Contains(str=name, searchFor=code_block, ignoreCase=code_block_2)
watch = Watch(contains)

filterByBoolMask = List.FilterByBoolMask(list=name, mask=contains)
watch_2 = Watch(filterByBoolMask.out)
watch_3 = Watch(filterByBoolMask.in)
filterByBoolMask_2 = List.FilterByBoolMask(list=all_elements_of_category, mask=contains)
watch_4 = Watch(filterByBoolMask_2.in)
name_2 = Element.Name(element=watch_4)

# group: This is abundance, but there's no harm in double checking.
import_check = Watch(name_2)

# group: PLEASE MAKE SURE YOU DISCONNECT THE ELEMENT.DELETE BEFORE SAVING OR RUNNING TO CHECK NAMES
watch_5 = Watch()  # unwired: arg0

watch_6 = Watch(all_elements_of_category)
watch_7 = Watch(name)
delete = Element.Delete()  # unwired: element
