# Dynamo graph Door Script.dyn (Dynamo 2.16.1.2727)

# group: SORT BY LEVEL
levels = Levels("Level 0")
all_elements_at_level = ElementsAtLevel(Level=levels)
getCategory = Element.GetCategory(element=all_elements_at_level)
string_from_object = FromObject(obj=getCategory)
code_block = CodeBlock { "Door"; }
startsWith = String.StartsWith(string=string_from_object, searchFor=code_block)
filterByBoolMask = List.FilterByBoolMask(list=all_elements_at_level, mask=startsWith)
flatten = List.Flatten(list=filterByBoolMask.in)

categories = Categories("OST_Areas")
all_elements_of_category = ElementsOfCategory(Category=categories)
boundaries = Area.Boundaries(area=all_elements_of_category)
code_block_2 = CodeBlock { 2000; }
byJoinedCurves = PolyCurve.ByJoinedCurves(curves=boundaries, joinTolerance=code_block_2)
code_block_3 = CodeBlock { 0; 1; 2; 3; }
getItemAtIndex = List.GetItemAtIndex(list=byJoinedCurves, index=code_block_3.out0)
boundingBox = Geometry.BoundingBox(geometry=getItemAtIndex@L2)
getLocation = Element.GetLocation(element=flatten)
contains = BoundingBox.Contains(boundingBox=boundingBox, point=getLocation@L4)
flatten_2 = List.Flatten(list=contains)
filterByBoolMask_2 = List.FilterByBoolMask(list=flatten, mask=flatten_2)
code_block_4 = CodeBlock { "DB.2."; }

# group: Count and create a sequence
count = List.Count(list=filterByBoolMask_2.in)
code_block_5 = CodeBlock(input=count) { 1..#input..1; }

# group: Depends on the type of parameters you'd use intergers or strings.
code_block_6 = CodeBlock { "Mark"; }
string_from_object_2 = FromObject(obj=code_block_5)

string_from_object_3 = FromObject(object=code_block_5)
add = code_block_4 + string_from_object_3
setParameterByName = Element.SetParameterByName(element=filterByBoolMask_2.in, parameterName=code_block_6, value=add)

# group: FILTERING OUT THE TYPE OF PARKING YOU DON'T WANT
string_from_object_4 = FromObject(object=flatten)
family_name_in_between_____here = CodeBlock { "4900 x 2600 (6.4M) no wheel stop"; }
contains_2 = String.Contains(string=string_from_object_4, searchFor=family_name_in_between_____here)
not_ = Not(x=contains_2)
filterByBoolMask_3 = List.FilterByBoolMask(list=flatten, mask=not_)

# group: SORT BY VIEW
categories_2 = Categories("OST_Doors")
all_elements_of_category_in_view = ElementsOfCategoryInView(Category=categories_2)  # unwired: View
watch = Watch(all_elements_of_category_in_view)

name = Element.Name(element=all_elements_of_category)
